# Dynamo graph script.dyn "Test_Manual_Run_script" (Dynamo 4.0.2.3852)

string = StringInput("This message confirms that dynami works")

# group: Attach this node to the end of your script to get a balloon notification when it is done
header_text = CodeBlock { "PyRevit Notification"; }
balloon_text = CodeBlock { "Manual Mode"; }
last_script_node = CodeBlock(Code=string) { Input = Code; }
balloon_notification = Python(IN[0]=header_text, IN[1]=balloon_text, IN[2]=last_script_node)  # PythonNet3
# ---------- balloon_notification.python (4 lines) ----------
import clr
from System import DateTime, Environment
from System.IO import File
File.AppendAllText(r'C:\temp\dyn-headless-auto.log', DateTime.Now.ToString('HH:mm:ss.fff') + ' graph ran' + Environment.NewLine)
# ----------------------------------------
